# Dynamo graph Change Wall Constraints to Selected Level.dyn (Dynamo 2.6.1.8786)
# packages: Clockwork for Dynamo 2.x 2.3.0, Genius Loci 2021.2.3, archi-lab.net 2021.25.19, Modelical 2.2.19, WombatDynamo 1.3.2

code_block = CodeBlock { List.; }

# group: Input
select_model_elements = DSModelElementsSelection()  # nothing selected

code_block_2 = CodeBlock { "Reference Level"; }
getParameterValueByName = Element.GetParameterValueByName(element=select_model_elements, parameterName=code_block_2)  # frozen
code_block_3 = CodeBlock { ""; }
ne = getParameterValueByName != code_block_3
filterByBoolMask = List.FilterByBoolMask(list=select_model_elements, mask=ne)  # frozen
code_block_4 = CodeBlock { "Level"; }
getParameterValueByName_2 = Element.GetParameterValueByName(element=filterByBoolMask.out, parameterName=code_block_4)
code_block_5 = CodeBlock { ""; }
ne_2 = getParameterValueByName_2 != code_block_5
filterByBoolMask_2 = List.FilterByBoolMask(list=filterByBoolMask.out, mask=ne_2)

# group: Input
levels = Levels()  # nothing selected

setParameterByName = Element.SetParameterByName(element=filterByBoolMask_2.in, parameterName=code_block_4, value=levels)
setParameterByName_2 = Element.SetParameterByName(element=filterByBoolMask.in, parameterName=code_block_4, value=levels)
list_create = List.Create(item0=setParameterByName, item1=setParameterByName_2)
firstItem = List.FirstItem(list=list_create)
list_create_2 = List.Create(item0=firstItem, item1=list_create)
flatten = List.Flatten(list=list_create_2)
getLocation = Element.GetLocation(element=setParameterByName)
getLocation_2 = Element.GetLocation(element=setParameterByName_2)
list_create_3 = List.Create(item0=getLocation, item1=getLocation_2)
firstItem_2 = List.FirstItem(list=list_create_3)
list_create_4 = List.Create(item0=firstItem_2, item1=list_create_3)
flatten_2 = List.Flatten(list=list_create_4)
setLocation = Element.SetLocation(element=flatten, geometry=flatten_2)
end = Revit.Transaction.Transaction.End()  # unwired: input
function_compose = ComposeFunctions()  # unwired: func0, func1
select_model_element = DSModelElementSelection()  # 1 picked in the model; graph input
code_block_6 = CodeBlock { "Base Constraint"; "Base Offset"; "Top Constraint"; "Top Offset"; }
list_create_5 = List.Create(item0=code_block_6.out0, item1=code_block_6.out2)

# group: Input
levels_2 = Levels("Zero Basepoint")  # graph input

list_create_6 = List.Create(item0=levels_2, item1=levels_2)
setParameterValuesByNames = WombatDynamo.Element.SetParameterValuesByNames(element=select_model_element, parameterNames=list_create_5@L1, values=list_create_6@L1)

# group: Input
select_model_elements_2 = DSModelElementsSelection()  # 1 picked in the model; graph input; frozen

getParameterValueByName_3 = Element.GetParameterValueByName(element=select_model_elements_2, parameterName=code_block_6.out0)
elevation = Level.Elevation(level=getParameterValueByName_3)
getParameterValueByName_4 = Element.GetParameterValueByName(element=select_model_elements_2, parameterName=code_block_6.out1)
add = elevation + getParameterValueByName_4
elevation_2 = Level.Elevation(level=levels_2)
sub = add - elevation_2
count = List.Count(list=sub)
cycle = List.Cycle(list=code_block_6.out1, amount=count)
passthrough = Custom[Passthrough](passThrough=cycle, waitFor=elevation)  # package Clockwork for Dynamo 2.x; Forces a sequential order of execution. The node wired into the output of the Passthrough node will be executed *after* the node wired into the waitFor input (e.g. important for some Revit operations). The value of the passThrough input will be passed on to the node wired into the output port of the Passthrough node.
setParameterByName_3 = Element.SetParameterByName(element=setParameterValuesByNames, parameterName=passthrough, value=sub)
getParameterValueByName_5 = Element.GetParameterValueByName(element=select_model_elements_2, parameterName=code_block_6.out2)
elevation_3 = Level.Elevation(level=getParameterValueByName_5)
getParameterValueByName_6 = Element.GetParameterValueByName(element=select_model_elements_2, parameterName=code_block_6.out3)
add_2 = elevation_3 + getParameterValueByName_6
sub_2 = add_2 - elevation_2
count_2 = List.Count(list=sub_2)
cycle_2 = List.Cycle(list=code_block_6.out3, amount=count_2)
passthrough_2 = Custom[Passthrough](passThrough=cycle_2, waitFor=elevation_3)
setParameterByName_4 = Element.SetParameterByName(element=setParameterValuesByNames, parameterName=passthrough_2, value=sub_2)
categories = Categories("OST_Walls")
all_elements_of_category = ElementsOfCategory(Category=categories)
code_block_7 = CodeBlock { "Base Constraint"; "Base Offset"; "Top Constraint"; "Top Offset"; }
getParameterValueByName_7 = Element.GetParameterValueByName(element=all_elements_of_category, parameterName=code_block_7.out2)
levels_3 = Levels()  # nothing selected
name = Level.Name()  # unwired: level
element_level = Custom[Element Level](element=all_elements_of_category)  # package Genius Loci; Gets an element's level. Based on a Clockwork's node
getParameterValueByName_8 = Element.GetParameterValueByName(element=all_elements_of_category, parameterName=code_block_7.out0)
string_from_object = FromObject(obj=getParameterValueByName_8)
code_block_8 = CodeBlock { "Zero Basepoint"; }
code_block_9 = CodeBlock { true; }
contains = String.Contains(str=string_from_object, searchFor=code_block_8, ignoreCase=code_block_9)
filterByBoolMask_3 = List.FilterByBoolMask(list=all_elements_of_category, mask=contains)
id = Element.Id(element=filterByBoolMask_3.out)
byElementId = archilab.Revit.Selection.Select.ByElementId(id=id)
selectInRevit = Custom[SelectInRevit](ElemsOrIDs=id)  # package Modelical; Select elements in Revit by Element or ID
